# Grasshopper definition maxwell_mapping.ghx (Grasshopper 0.9.76)
# plug-ins: Python Interpreter, Scarab.Generic, Scarab, EleFront

# Sample primitives
number_slider = Slider(1, range=0..1)
material_name = Panel("meadow")
material_name_2 = Panel("checker")

# ----
# "Texture library" path.
# Nodes will search for texture file in this directory.
# Firstly it tries to find the same file name as given material name, if it wasn't found - it searching for similiar names.
relfilepath = RelativeFilePath()  # -> Path
# ---------- relfilepath: Python ----------
# Relative path by StepMaher https://gist.github.com/StepMaher/d85b59a7c38108dec3c1

"""
Finds a file in the same directory as the Grasshopper file.
    Inputs: Name: File name and extiestion to grab.
    Outputs: Path: Full file path.
"""

# Name component
ghenv.Component.Name = "Relative File Path"
ghenv.Component.NickName = "RelFilePath"

# Import libraries
import os
import Grasshopper as gh

# Get GH file path
gh_path = ghdoc.Path
dir = os.path.dirname(os.path.realpath(gh_path))
if not Name:
    Name = ""
# Join GH file path and file name
Path = os.path.join(dir, Name)
# ---------- end relfilepath ----------
panel = Panel(relfilepath)
path = FilePath(panel)

num = Number(number_slider)
num_2 = Number(Slider(0.72, range=0..1))

texture_preview = BooleanToggle(False)
on_off = BooleanToggle(True)
bool = Boolean(on_off)
bool_2 = Boolean(texture_preview)

addition = Addition(A=num, B=num_2)
txt = Text(material_name_2)
series = Series(Start=0, Step=addition, Count=5)
pt = ConstructPoint(XCoordinate=series, YCoordinate=0, ZCoordinate=0)
xy = XYPlane(Origin=pt)
item = ListItem(List=pt, Index=0, Wrap=True)  # -> Item, Item1, Item2, Item3, Item4

division = Division(A=num, B=2)
xy_2 = XYPlane(Origin=item.Item)
box = CenterBox(Base=xy_2, X=division, Y=division, Z=division)
debrep = DeconstructBrep(Brep=box)  # -> Faces, Edges, Vertices
item_2 = ListItem(List=debrep.Vertices, Index=0, Wrap=True)  # -> Item2, Item1, Item, Item1_2
srf4pt = _4PointSurface(CornerA=item_2.Item2, CornerB=item_2.Item1, CornerC=item_2.Item, CornerD=item_2.Item1_2)

xy_3 = XYPlane(Origin=item.Item1)
box_2 = CenterBox(Base=xy_3, X=division, Y=division, Z=division)
debrep_2 = DeconstructBrep(Brep=box_2)  # -> Faces, Edges, Vertices
item_3 = ListItem(List=debrep_2.Vertices, Index=0, Wrap=True)  # -> Item2, Item1, Item, Item1_2
number_slider_2 = Slider(10, range=0..10)
avr = Average(Input=[item_3.Item2, item_3.Item1])
avr_2 = Average(Input=[item_3.Item, item_3.Item1_2])
ln = Line(StartPoint=item_3.Item2, EndPoint=item_3.Item1_2)
ln_2 = Line(StartPoint=avr, EndPoint=avr_2)
ln_3 = Line(StartPoint=item_3.Item1, EndPoint=item_3.Item)
cluster = Cluster_5(C=ln, N=number_slider_2)  # -> X, Y, R, I
cluster_2 = Cluster_5(C=ln_2, N=number_slider_2)  # -> X, Y, R, I
cluster_3 = Cluster_3(C=ln_3, N=number_slider_2)  # -> X, Y, R, I
graph = GraphMapper(cluster.R, x0=0, x1=1, y0=0, y1=1, container_name="Bezier", cpx=[0, 0.4463766217, 0, 1], cpy=[0, 0, 1, 1])
graph_2 = GraphMapper(cluster_2.R, x0=0, x1=1, y0=0, y1=1, container_name="Bezier", cpx=[0, 0, 0.0159421172, 1], cpy=[0, 0.5089854002, 1, 1])
graph_3 = GraphMapper(cluster_3.R, x0=0, x1=1, y0=0, y1=1, container_name="Bezier", cpx=[0, 0, 1, 1], cpy=[0, 0.5289855003, 0.5005573034, 1])
cluster_4 = Cluster_6(X=cluster.X, Y=cluster.Y, V=graph, T=cluster.I)
cluster_5 = Cluster_6(X=cluster_2.X, Y=cluster_2.Y, V=graph_2, T=cluster_2.I)
cluster_6 = Cluster_4(X=cluster_3.X, Y=cluster_3.Y, V=graph_3, T=cluster_3.I)
loft = Loft(
    Curves=[cluster_4, cluster_5, cluster_6],
    Options={Adjust=False, Closed=False, LoftEnds=0, LoftSimp=0, LoftType=0, Rebuild=10, Refit=0.01})

xy_4 = XYPlane(Origin=item.Item2)
box_3 = CenterBox(Base=xy_4, X=division, Y=division, Z=division)

num_3 = Number(division)
xz = XZPlane(Origin=item.Item3)
division_2 = Division(A=num_3, B=3.141592654)
addition_2 = Addition(A=num_3, B=division_2)
Y = UnitY(Factor=num_3)
cyl = Cylinder(Base=xz, Radius=addition_2, Length=num)
move = Move(Geometry=cyl, Motion=Y)  # -> Geometry, Transform
cap = CapHoles(Brep=move.Geometry)

xy_5 = XYPlane(Origin=item.Item4)
sph = Sphere(Base=xy_5, Radius=addition_2)

txt_2 = Text(txt)
material_name_3 = Panel(txt_2)
material_name_4 = Panel(txt_2)
material_name_5 = Panel(txt_2)
merge = Merge(Data1=flatten(srf4pt), Data2=flatten(loft), Data3=flatten(box_3), Data4=flatten(cap), Data5=flatten(sph))
Y_2 = UnitY(Factor=expr("-x", series))
move_2 = Move(Geometry=xy, Motion=graft(Y_2))  # -> Geometry, Transform

# ---- group: Base planes
bang = ExplodeTree(Data=move_2.Geometry)  # -> Branch0, Branch1, Branch2, Branch3, Branch4

# ----
pln = Plane(bang.Branch4)
move_3 = Move(Geometry=merge, Motion=graft(Y_2))  # -> Geometry, Transform

# ---- group: Geometry
bang_2 = ExplodeTree(Data=move_3.Geometry)  # -> Branch0, Branch1, Branch2, Branch3, Branch4

# ---- group: Deconstruct to surfaces
debrep_3 = DeconstructBrep(Brep=bang_2.Branch2)  # -> Faces, Edges, Vertices

# ----
geo = Geometry(bang_2.Branch3)
pln_2 = Plane(bang.Branch3)
list = ValueList({"planar": 0, "box": 1, "surface": 2, "cylinder": 3, "shpere": 4}, selected="cylinder")
bool_3 = Boolean(bool)
bool_4 = Boolean(bool_2)
xz_2 = XZPlane(Origin=pln_2)
vec = VectorXYZ(XComponent=Slider(0.57, range=0..10), YComponent=Slider(1, range=0..10), ZComponent=0)  # -> Vector, Length
cluster_7 = Cluster_2(
    on=bool_3,
    preview=bool_4,
    texturelibpath=path,
    materialname=material_name_4,
    mapmode=list,
    dimensions=vec.Vector,
    pln=xz_2,
    geometry=geo)  # -> path_3, data_2

list_2 = ValueList({"planar": 0, "box": 1, "surface": 2}, selected="planar")
# Mapping
bool_5 = Boolean(bool)
material_name_6 = Panel(txt_2)
bool_6 = Boolean(bool_2)
geo_2 = Geometry(bang_2.Branch0)
cluster_8 = Cluster_2(on=bool_5, preview=bool_6, texturelibpath=path, materialname=material_name_6, mapmode=list_2, geometry=geo_2)  # -> path_3, data_2

list_3 = ValueList({"planar": 0, "box": 1, "surface": 2, "cylinder": 3, "shpere": 4}, selected="box")
material_name_7 = Panel(txt_2)
bool_7 = Boolean(bool)
bool_8 = Boolean(bool_2)
geo_3 = Geometry(bang_2.Branch1)
cluster_9 = Cluster_2(on=bool_7, preview=bool_8, texturelibpath=path, materialname=material_name_7, mapmode=list_3, geometry=geo_3)  # -> path_3, data_2

list_4 = ValueList({"planar": 0, "box": 1, "surface": 2, "cylinder": 3, "shpere": 4}, selected="surface")
bool_9 = Boolean(bool)
bool_10 = Boolean(bool_2)
geo_4 = Geometry(debrep_3.Faces)
cluster_10 = Cluster_2(on=bool_9, preview=bool_10, texturelibpath=path, materialname=material_name_3, mapmode=list_4, geometry=geo_4)  # -> path_3, data_2

list_5 = ValueList({"planar": 0, "box": 1, "surface": 2, "cylinder": 3, "shpere": 4}, selected="shpere")
bool_11 = Boolean(bool)
geo_5 = Geometry(bang_2.Branch4)
bool_12 = Boolean(bool_2)
cluster_11 = Cluster_2(on=bool_11, preview=bool_12, texturelibpath=path, materialname=material_name_5, mapmode=list_5, pln=pln, geometry=geo_5)  # -> path_3, data_2

# ---- group: Creates material
path_2 = FilePath(cluster_8.path_3)
# Creates material
txt_3 = Text(txt_2)
mxtexsimple = SimpleMaxwellTexture(
    TexturePath=path_2,
    AlternativeColor=RGB(211, 211, 211),
    Value=Domain(99, 100),
    ProjectorChannel=0,
    UseRealScale=False,
    TileX=True,
    TileY=True,
    Tilesize=Point(1, 1, 1),
    Offset=Point(0, 0, 0))  # -> TextureSlot, TextureName
mxbase = MaxwellBasicMaterial(
    Name=txt_3,
    DiffuseColor0=mxtexsimple.TextureSlot,
    DiffuseColor90=mxtexsimple.TextureSlot,
    Attenuation=10,
    IndexOfRefraction=3,
    ExtinctionCoefficient=0,
    Roughness=Slider(99, range=0..100),
    Anisotropy=0,
    PreviewSL=0)

# ----
# Bake
entwine = Entwine(
    Branch00=cluster_8.data_2,
    Branch01=cluster_9.data_2,
    Branch02=cluster_10.data_2,
    Branch03=cluster_7.data_2,
    Branch04=cluster_11.data_2,
    FlattenInputs=True)
cluster_12 = Cluster(data=entwine)  # -> T, T_2

# ---- group: Bake with Elefront extension - push the button
attributes = ObjectAttributes(Name="MaxwellBake", Material=cluster_12.T_2)
bake = BakeObjects(Geometry=cluster_12.T, Attributes=attributes, Bake=Button())

# ---- group: Bake with Scarab - right click - Bake (as usual)
attr = BakeAttributes(Name="MaxwellBake", Layer="MaxwellBake")
mxbake = MaxwellMaterialBake(Geometry=cluster_12.T, Layer=attr, MaxwellMaterial=cluster_12.T_2, GroupObjects=False)

# ==== cluster Cluster
data = ClusterInput()
data_2 = Data(data)
geo = Geometry(data_2)
null = NullItem(Item=geo)  # -> NullFlags, InvalidFlags, Description
panel = Panel(data_2)
cull = CullPattern(List=data_2, CullPattern=invert(null.NullFlags))
cull_2 = CullPattern(List=data_2, CullPattern=null.NullFlags)
clean = CleanTree(Tree=cull, CleanInvalid=True, CleanEmpty=False)
clean_2 = CleanTree(Tree=cull_2, CleanInvalid=True, CleanEmpty=False)
T = ClusterOutput(clean)
T_2 = ClusterOutput(clean_2)

# ==== cluster Cluster_2
preview = ClusterInput()
on = ClusterInput()
texturelibpath = ClusterInput()
materialname = ClusterInput()
previewcolor = ClusterInput()
dimensions = ClusterInput()
mapgeom = ClusterInput()
mapmode = ClusterInput()
meshqual = ClusterInput()
geometry = ClusterInput()
pln = ClusterInput()
on_2 = Boolean(on)
preview_2 = Boolean(preview)
gate = StreamGate(Stream=preview_2, Gate=on_2)  # -> Target0, Target1
on_3 = Boolean(on_2)
pln_2 = Plane(pln)
geometry_2 = Geometry(geometry)
meshqual_2 = Boolean(meshqual)
texturelibpath_2 = FilePath(texturelibpath)
materialname_2 = Text(materialname)

# ---- group: Mode
# planar  = 0
# box     = 1
# surface = 2
# cylinder = 3
# shpere = 4
mapmode_2 = Integer(mapmode)
if_empty = IfNullThen(data=mapmode_2, data_2=Slider(2, range=0..10))
mappingmode = Integer(if_empty)
gate_2 = StreamGate(Stream=mappingmode, Gate=on_3)  # -> Target0, Target1
mapping_mode = Integer(gate_2.Target1)

# ----
mapgeom_2 = Geometry(mapgeom)
dimensions_2 = Vector(dimensions)
on_4 = Boolean(gate.Target1)
xy = XYPlane(Origin=Point(0, 0, 0))
vec = Vector(Vector(0, 0, 0))
if_empty_2 = IfNullThen(data=dimensions_2, data_2=vec)
if_empty_3 = IfNullThen(data=meshqual_2, data_2=Toggle(False))
if_empty_4 = IfNullThen(data=pln_2, data_2=xy)
gate_3 = StreamGate(Stream=dimensions_2, Gate=on_3)  # -> Target0, Target1
gate_4 = StreamGate(Stream=if_empty_4, Gate=on_3)  # -> Target0, Target1
gate_5 = StreamGate(Stream=geometry_2, Gate=on_3)  # -> Target0, Target1
geo = Geometry(gate_5.Target1)

# ---- group: Convert geom to mesh / separate brep and meshes
brep = Brep(geo)
null = NullItem(Item=brep)  # -> NullFlags, InvalidFlags, Description
dispatch = Dispatch(List=geo, DispatchPattern=null.NullFlags)  # -> ListA, ListB

# ---- group: Convert geom to mesh
jagged = SettingsSpeed()
smooth = SettingsQuality()
filter = StreamFilter(Gate=if_empty_3, Stream0=jagged, Stream1=smooth)
mesh = MeshBrep(Brep=dispatch.ListB, Settings=filter)
mesh_2 = Mesh([mesh, dispatch.ListA])

# ----
gate_6 = StreamGate(Stream=texturelibpath_2, Gate=on_3)  # -> Target0, Target1
gate_7 = StreamGate(Stream=materialname_2, Gate=on_3)  # -> Target0, Target1
previewcolor_2 = Colour(previewcolor)
если_ноль = IfNullThen(data=previewcolor_2, data_2=ColourSwatch(SwatchColor=RGB(150, 150, 150)))

# ---- group: Gate Mode
gate_8 = StreamGate(Stream=mapgeom_2, Gate=mapping_mode)  # -> Target0, Target1, Target2, Target3, Target4
gate_9 = StreamGate(Stream=gate_3.Target1, Gate=mapping_mode)  # -> Target0, Target1, Target2, Target3, Target4
gate_10 = StreamGate(Stream=gate_4.Target1, Gate=mapping_mode)  # -> Target0, Target1, Target2, Target3, Target4
gate_11 = StreamGate(Stream=geo, Gate=mapping_mode)  # -> Target0, Target1, Target2, Target3, Target4
gate_12 = StreamGate(Stream=geo, Gate=mapping_mode)  # -> Target0, Target1, Target2, Target3, Target4
gate_13 = StreamGate(Stream=mesh_2, Gate=mapping_mode)  # -> Target0, Target1, Target2, Target3, Target4

# ---- group: Finds texture and material
mlist = MaterialList()  # -> Materials, Debug
path = FilePath(gate_6.Target1)
mat_name = Text(gate_7.Target1)
concat = Concatenate(FragmentC="*", FragmentA=mat_name, FragmentB="*")
folder = FolderList(Folder=path, Pattern=concat)
tmatch = MatchText(Text=mlist.Materials, Pattern=concat, Case=False)
tmatch_2 = MatchText(Text=mlist.Materials, Pattern=mat_name, Case=False)
item = ListItem(List=folder, Index=0, Wrap=True)
cull = CullPattern(List=mlist.Materials, CullPattern=tmatch_2)
cull_2 = CullPattern(List=mlist.Materials, CullPattern=tmatch)
lng = ListLength(List=cull)
equals = Equality(FirstNumber=lng, SecondNumber=0)  # -> Equality, Inequality
weave = Weave(Pattern=equals.Inequality, Stream0=cull_2, Stream1=cull, NullGaps=False)
path_2 = FilePath(item)
txt = Text(weave)

# ---- group: 2 - Surface
mesh_3 = Mesh(gate_13.Target2)
geo_2 = Geometry(gate_8.Target2)
geo_3 = Geometry(gate_11.Target2)
item_2 = ListItem(List=geo_2, Index=0, Wrap=True)
srf = Surface(geo_3)
null_2 = NullItem(Item=item_2)  # -> NullFlags, InvalidFlags, Description
filter_2 = StreamFilter(Gate=null_2.NullFlags, Stream0=geo_2, Stream1=srf)
surfacemap = SurfaceMapping(Mesh=mesh_3, Surface=filter_2)
mesh_4 = Mesh(surfacemap)

# ---- group: 3 - Cylinder
mesh_5 = Mesh(gate_13.Target3)
vec_2 = Vector(gate_9.Target3)
pln_3 = Plane(gate_10.Target3)
devec = DeconstructVector(Vector=vec_2)  # -> XComponent, YComponent, ZComponent
division = Division(A=devec.YComponent, B=2)
circle = CircleCNR(Center=pln_3, Normal=pln_3, Radius=devec.XComponent)
amp = Amplitude(Vector=pln_3, Amplitude=division)
move = Move(Geometry=circle, Motion=expr("-x", amp))  # -> Geometry, Transform
cylindermap = CylinderMapping(Mesh=mesh_5, BaseCircle=move.Geometry, Height=devec.YComponent)  # -> MappedMesh, MappingCylinder
mesh_6 = Mesh(cylindermap.MappedMesh)

# ----
bool = Boolean(on_4)
path_3 = ClusterOutput(path_2)

# ---- group: 0 - Planar
pln_4 = Plane(gate_10.Target0)
geo_4 = Geometry(gate_12.Target0)
mesh_7 = Mesh(gate_13.Target0)
vec_3 = Vector(gate_9.Target0)

# ---- group: 0 - Planar / If no vector provided - generate plane by bbox
item_3 = ListItem(List=vec_3, Index=0, Wrap=True)
null_3 = NullItem(Item=item_3)  # -> NullFlags, InvalidFlags, Description
gate_14 = StreamGate(Stream=vec_3, Gate=null_3.NullFlags)  # -> Target0, Target1
gate_15 = StreamGate(Stream=geo_4, Gate=null_3.NullFlags)  # -> Target0, Target1

# ---- group: 0 - Planar / Plane by bbox
bbox = BoundingBox(Content=gate_15.Target1, Plane=pln_4)  # -> Box, Box_2
debox = DeconstructBox(Box=bbox.Box)  # -> Plane, X, Y, Z

# ---- group: 0 - Planar / Plane by coords
devec_2 = DeconstructVector(Vector=gate_14.Target0)  # -> XComponent, YComponent, ZComponent
domain = Domain(devec_2.XComponent)
domain_2 = Domain(devec_2.YComponent)

# ---- group: 0 - Planar (continued)
filter_3 = StreamFilter(Gate=null_3.NullFlags, Stream0=domain_2, Stream1=debox.Y)
filter_4 = StreamFilter(Gate=null_3.NullFlags, Stream0=domain, Stream1=debox.X)
planarmap = PlanarMapping(Mesh=mesh_7, Plane=pln_4, XExtents=filter_4, YExtents=filter_3)  # -> MappedMesh, MappingPlane
mesh_8 = Mesh(planarmap.MappedMesh)

# ---- group: 2 - Box
mesh_9 = Mesh(gate_13.Target1)
vec_4 = Vector(gate_9.Target1)
pln_5 = Plane(gate_10.Target1)
geo_5 = Geometry(gate_8.Target1)

# ---- group: 2 - Box / Check is geom=box, and if vector given
box = Box(geo_5)
item_4 = ListItem(List=vec_4, Index=0, Wrap=True)
item_5 = ListItem(List=box, Index=0, Wrap=True)
null_4 = NullItem(Item=item_4)  # -> NullFlags, InvalidFlags, Description
null_5 = NullItem(Item=item_5)  # -> NullFlags, InvalidFlags, Description
and = GateAnd(A=null_4.NullFlags, B=null_5.NullFlags)

# ---- group: 2 - Box / If no geom and dimensions - bbox
gate_16 = StreamGate(Stream=mesh_9, Gate=and)  # -> Target0, Target1
gate_17 = StreamGate(Stream=pln_5, Gate=and)  # -> Target0, Target1
bbox_2 = BoundingBox(Content=gate_16.Target1, Plane=gate_17.Target1)  # -> Box, Box_2

# ---- group: 2 - Box / If no geom provided - box by dimensions
gate_18 = StreamGate(Stream=gate_17.Target0, Gate=null_5.NullFlags)  # -> Target0, Target1
gate_19 = StreamGate(Stream=vec_4, Gate=null_5.NullFlags)  # -> Target0, Target1
devec_3 = DeconstructVector(Vector=gate_19.Target1)  # -> XComponent, YComponent, ZComponent
box_2 = DomainBox(Base=gate_18.Target1, X=devec_3.XComponent, Y=devec_3.YComponent, Z=devec_3.ZComponent)

# ---- group: 2 - Box (continued)
filter_5 = StreamFilter(Gate=null_5.NullFlags, Stream0=box, Stream1=box_2)
filter_6 = StreamFilter(Gate=and, Stream0=filter_5, Stream1=bbox_2.Box)
boxmap = BoxMapping(Mesh=mesh_9, Box=filter_6)
mesh_10 = Mesh(boxmap)

# ---- group: 4 - Sphere
mesh_11 = Mesh(gate_13.Target4)
pln_6 = Plane(gate_10.Target4)
item_6 = ListItem(List=pln_6, Index=0, Wrap=True)
null_6 = NullItem(Item=item_6)  # -> NullFlags, InvalidFlags, Description
gate_20 = StreamGate(Stream=mesh_11, Gate=null_6.NullFlags)  # -> Target0, Target1

# ---- group: 4 - Sphere / Find center point if plane not given
demesh = DeconstructMesh(Mesh=gate_20.Target1)  # -> Vertices, Faces, Colours, Normals
avr = Average(Input=demesh.Vertices)
pshift = ShiftPaths(Data=avr, Offset=-1)

# ---- group: 4 - Sphere (continued)
filter_7 = StreamFilter(Gate=null_6.NullFlags, Stream0=pln_6, Stream1=pshift)
sphericalmap = SphericalMapping(Mesh=mesh_11, BasePlane=filter_7)  # -> MappedMesh, MappingSphere
mesh_12 = Mesh(sphericalmap.MappedMesh)

# ----
filter_8 = StreamFilter(Gate=mapping_mode, Stream0=mesh_8, Stream1=mesh_10, Stream2=mesh_4, Stream3=mesh_6, Stream4=mesh_12)
gate_21 = StreamGate(Stream=filter_8, Gate=bool)  # -> Target0, Target1

# ---- group: Combine ouptut for baking
mesh_13 = Mesh(filter_8)
mat_name_2 = Text(txt)
merge = Merge(Data1=mat_name_2, Data2=mesh_13)  # -> flatten(Result)
filter_9 = StreamFilter(Gate=on_3, Stream1=merge)
clean = CleanTree(RemoveNulls=True, RemoveInvalid=True, RemoveEmpty=True, Tree=filter_9)
data = Data(clean)
data_2 = ClusterOutput(data)

# ---- group: Preview with mapping
mesh_14 = Mesh(gate_21.Target1)
path_4 = FilePath(path_2)
null_7 = NullItem(Item=path_4)  # -> NullFlags, InvalidFlags, Description
filter_10 = StreamFilter(Gate=null_7.NullFlags, Stream0=path_4)
filter_11 = StreamFilter(Gate=null_7.NullFlags, Stream0=ColourSwatch(SwatchColor=RGB(255, 255, 255)), Stream1=previewcolor_2)
previewmat = CustomPreviewMaterials(Geometry=mesh_14, DiffuseColor=filter_11, DiffuseBitmap=filter_10)

# ---- group: Preview color
mesh_15 = Mesh(gate_21.Target0)
preview_3 = CustomPreview(Geometry=mesh_15, Shader=если_ноль)

# ==== cluster Cluster_3
C = ClusterInput()
N = ClusterInput()
divide = DivideCurve(Curve=C, Count=N, Kinks=False)  # -> Points, Tangents, Parameters
pdecon = Deconstruct(Point=divide.Points)  # -> XComponent, YComponent, ZComponent
bnd = Bounds(Numbers=pdecon.YComponent)
remap = RemapNumbers(Value=pdecon.ZComponent, Source=bnd, Target=Domain(0, 1))  # -> Mapped, Clipped
X = ClusterOutput(pdecon.XComponent)
Y = ClusterOutput(pdecon.YComponent)
R = ClusterOutput(remap.Mapped)
I = ClusterOutput(bnd)

# ==== cluster Cluster_4
X = ClusterInput()
Y = ClusterInput()
V = ClusterInput()
T = ClusterInput()
remap = RemapNumbers(Value=V, Source=Domain(0, 1), Target=T)  # -> Mapped, Clipped
pt = ConstructPoint(XCoordinate=X, YCoordinate=Y, ZCoordinate=remap.Mapped)
nurbs = NurbsCurve(Vertices=pt, Degree=3, Periodic=False)  # -> Curve, Length, Domain
C = ClusterOutput(nurbs.Curve)

# ==== cluster Cluster_5
C = ClusterInput()
N = ClusterInput()
divide = DivideCurve(Curve=C, Count=N, Kinks=False)  # -> Points, Tangents, Parameters
pdecon = Deconstruct(Point=divide.Points)  # -> XComponent, YComponent, ZComponent
bnd = Bounds(Numbers=pdecon.YComponent)
X = ClusterOutput(pdecon.XComponent)
Y = ClusterOutput(pdecon.YComponent)
remap = RemapNumbers(Value=pdecon.ZComponent, Source=bnd, Target=Domain(0, 1))  # -> Mapped, Clipped
I = ClusterOutput(bnd)
R = ClusterOutput(remap.Mapped)

# ==== cluster Cluster_6
V = ClusterInput()
T = ClusterInput()
X = ClusterInput()
Y = ClusterInput()
remap = RemapNumbers(Value=V, Source=Domain(0, 1), Target=T)  # -> Mapped, Clipped
pt = ConstructPoint(XCoordinate=X, YCoordinate=Y, ZCoordinate=remap.Mapped)
nurbs = NurbsCurve(Vertices=pt, Degree=3, Periodic=False)  # -> Curve, Length, Domain
C = ClusterOutput(nurbs.Curve)

# ==== cluster IfNullThen: if null then data
data = ClusterInput()
data_2 = ClusterInput()
data_3 = Data(data)
data_4 = Data(data_2)
null = NullItem(Item=data_3)  # -> NullFlags, InvalidFlags, Description
p_n_c = PickNChoose(Pattern=null.NullFlags, Stream0=data_3, Stream1=data_4)
R = ClusterOutput(p_n_c)
